# Grasshopper definition Hexcells_17012024.gh (Grasshopper 1.0.7)
# plug-ins: LunchBox, Weaverbird, ShapeDiverForGrasshopper

sddp = ShapeDiverDocumentPayload({AbsoluteTolerance=0, AngleTolerance=0, DistanceDisplayPrecision=0, GltfVersion="Gltf2", GrasshopperVersion="1.0.0007", InputGroups="{}", OutputGroups="{}", RelativeTolerance=0, RhinoVersion="7.34.23267.11001", UnitSystem=0, VersionCreated="1.16.0.0", VersionSaved="1.16.0.0"})
radius = GetInteger(Slider(3, range=0..10), AtLeast=1, AtMost=1, Maximum=2147483647, Minimum=-2147483648, TreeAccess=False)
u_divisions = GetInteger(Slider(30, range=0..100), AtLeast=1, AtMost=1, Maximum=2147483647, Minimum=-2147483648, TreeAccess=False)
v_divisions = GetInteger(Slider(15, range=0..100), AtLeast=1, AtMost=1, Maximum=2147483647, Minimum=-2147483648, TreeAccess=False)
height = GetNumber(Slider(4.5, range=0..10), AtLeast=1, AtMost=1, Maximum=1.797693135e+308, Minimum=-1.797693135e+308, TreeAccess=False)
negative = Negative(Value=height)
surface = Surface(<surface referenced from the Rhino model>)
hexagon_cells = HexagonCells(Surface=surface, UDivisions=u_divisions, VDivisions=v_divisions, TParameter=0.25)  # -> HexagonCells, Centers
offset_surface = OffsetSurface(Surface=surface, Distance=negative, Retrim=Toggle(True))
surface_closest_point = SurfaceClosestPoint(Point=hexagon_cells.Centers, Surface=offset_surface)  # -> Point, UVPoint, Distance
divide_curve = DivideCurve(Curve=hexagon_cells.HexagonCells, Count=Slider(1, range=0..100), Kinks=False)  # -> flatten(Points), Tangents, Parameters
vector_2pt = Vector2Pt(PointA=hexagon_cells.Centers, PointB=surface_closest_point.Point, Unitize=Toggle(False))  # -> Vector, Length
plane_normal = PlaneNormal(Origin=surface_closest_point.Point, ZAxis=vector_2pt.Vector)
circle = Circle(Plane=plane_normal, Radius=radius)  # -> flatten(Circle)
area = Area(Geometry=circle)  # -> Area, Centroid
surface_closest_point_2 = SurfaceClosestPoint(Point=divide_curve.Points, Surface=circle)  # -> Point, UVPoint, Distance
line = Line(StartPoint=divide_curve.Points, EndPoint=surface_closest_point_2.Point)
line_2 = Line(StartPoint=hexagon_cells.Centers, EndPoint=area.Centroid)
rail_revolution = RailRevolution(Curve=line, Rail=hexagon_cells.HexagonCells, Axis=line_2, Scale=False)
brep_join = BrepJoin(Breps=rail_revolution)  # -> Breps, Closed
mesh_brep = MeshBrep(
    Brep=brep_join.Breps,
    Settings={GridMaxCount=0, GridMinCount=16, JaggedSeams=False, MaxEdgeLength=0, MinEdgeLength=0.0001, MinTolerance=0, Refine=True, RefineAngle=0, RelativeTolerance=0.65, SimplePlanes=True, Tolerance=0})
weaverbird_s_mesh_thicken = WeaverbirdsMeshThicken(MeshCurves=mesh_brep, Distance=Slider(3, range=0..10), OffsetType=0)
wbloop = WeaverbirdsLoopSubdivision(MeshCurves=weaverbird_s_mesh_thicken, Level=Slider(2, range=0..10), SmoothNakedEdges=1)
mesh = Mesh(wbloop)
context_bake = ContextBake(Geometry=mesh)
